# Grasshopper definition Room_Area_optimization_v4--.gh (Grasshopper 1.0.7)
# plug-ins: Heteroptera, NGon 2, Colibri

number_slider = Slider(5, range=5..8)  # disabled
number_slider_2 = Slider(7, range=5..8)  # disabled

genes = GenePool(Decimals=1, Maximum=0.7, Minimum=-0.7, Value=[-0.6, -0.7, -0.7, -0.6, -0.6, -0.7, -0.7, -0.7, -0.7, -0.4])  # disabled
number_slider_3 = Slider(0.7, range=0..0.75)  # disabled
number_slider_4 = Slider(-0.7, range=-0.75..0)  # disabled
number_slider_5 = Slider(1, range=1..5)  # disabled
dom = ConstructDomain(DomainStart=number_slider_4, DomainEnd=number_slider_3)  # disabled
eval = Evaluate(F="(x+y) -2", x=number_slider_2, y=number_slider)  # disabled
gnc = GenePoolController(GenePool=genes, Count=eval, Domain=dom, Decimal=number_slider_5, RandomizeAmount=0.1, rand=False)  # disabled

number_slider_6 = Slider(7, range=5..8)
number_slider_7 = Slider(6, range=5..8)

genes_2 = GenePool(Decimals=0, Maximum=5, Minimum=1, Value=[1, 1, 1, 1, 1, 1, 1, 1, 1, 1, 1])
domain = Domain(Domain(1, 5))
dom_2 = ConstructDomain(DomainStart=Slider(-0.7, range=-0.75..0), DomainEnd=Slider(0.7, range=0..0.75))
number_slider_8 = Slider(1, range=1..5)
remap = RemapNumbers(Value=genes_2, Source=domain, Target=dom_2)  # -> Mapped, Clipped
eval_2 = Evaluate(F="(x+y) -2", x=number_slider_6, y=number_slider_7)
gnc_2 = GenePoolController(GenePool=genes_2, Count=eval_2, Decimal=0, RandomizeAmount=0.1, rand=False)

number_slider_9 = Slider(7, range=5..8)  # disabled
number_slider_10 = Slider(8, range=5..8)  # disabled

genes_3 = GenePool(
    Decimals=1,
    Maximum=5,
    Minimum=1,
    Value=[3, 1, 2.428571429, 5, 4.142857143, 4.428571429, 1.285714286, 2.428571429, 3, 3, 3, 3, 3])  # disabled
domain_2 = Domain(Domain(1, 5))  # disabled
number_slider_11 = Slider(0.7, range=0..0.75)  # disabled
number_slider_12 = Slider(-0.7, range=-0.75..0)  # disabled
dom_3 = ConstructDomain(DomainStart=number_slider_12, DomainEnd=number_slider_11)  # disabled
number_slider_13 = Slider(1, range=1..5)  # disabled
remap_2 = RemapNumbers(Value=genes_3, Source=domain_2, Target=dom_3)  # -> Mapped, Clipped; disabled
eval_3 = Evaluate(F="(x+y) -2", x=number_slider_9, y=number_slider_10)  # disabled
gnc_3 = GenePoolController(GenePool=genes_3, Count=eval_3, Decimal=number_slider_13, RandomizeAmount=0.1, rand=False)  # disabled

crv = Curve(<curve referenced from the Rhino model>)  # disabled
inner_line = Curve(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)  # disabled
crv_2 = Curve(<curve referenced from the Rhino model>)
inner_line_2 = Curve(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)
crv_3 = Curve(<curve referenced from the Rhino model>)  # disabled
inner_line_3 = Curve(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)  # disabled
eval_4 = Evaluate(F="x-1", x=eval)  # disabled
divide = DivideCurve(Curve=reparameterize(inner_line), Count=number_slider_2, Kinks=False)  # -> Points, Tangents, Parameters; disabled
divide_2 = DivideCurve(Curve=reparameterize(inner_line), Count=number_slider, Kinks=False)  # -> Points, Tangents, Parameters; disabled
subtraction = Subtraction(A=number_slider_2, B=1)  # disabled
eval_5 = Evaluate(F="x-1", x=eval_2)
eval_6 = Evaluate(F="x-1", x=eval_3)  # disabled
split = SplitList(List=genes, Index=subtraction)  # -> ListA, ListB; disabled
divide_3 = DivideCurve(Curve=reparameterize(inner_line_2), Count=number_slider_6, Kinks=False)  # -> Points, Tangents, Parameters
divide_4 = DivideCurve(Curve=reparameterize(inner_line_2), Count=number_slider_7, Kinks=False)  # -> Points, Tangents, Parameters
subtraction_2 = Subtraction(A=number_slider_6, B=1)
divide_5 = DivideCurve(Curve=reparameterize(inner_line_3), Count=number_slider_9, Kinks=False)  # -> Points, Tangents, Parameters; disabled
divide_6 = DivideCurve(Curve=reparameterize(inner_line_3), Count=number_slider_10, Kinks=False)  # -> Points, Tangents, Parameters; disabled
subtraction_3 = Subtraction(A=number_slider_9, B=1)  # disabled

X = UnitX(Factor=1)  # disabled
item = ListItem(List=divide.Points, Index=0, Wrap=True)  # disabled
move = Move(Geometry=item, Motion=X)  # -> Geometry, Transform; disabled
X_2 = UnitX(Factor=-1)  # disabled
Y = UnitY(Factor=1)  # disabled
X_3 = UnitX(Factor=1)  # disabled
Y_2 = UnitY(Factor=-1)  # disabled
project = ProjectPoint(Point=move.Geometry, Direction=Y_2, Geometry=crv)  # -> Point, Index; disabled
project_2 = ProjectPoint(Point=move.Geometry, Direction=Y, Geometry=crv)  # -> Point, Index; disabled
project_3 = ProjectPoint(Point=move.Geometry, Direction=X_3, Geometry=crv)  # -> Point, Index; disabled
project_4 = ProjectPoint(Point=move.Geometry, Direction=X_2, Geometry=crv)  # -> Point, Index; disabled

split_2 = SplitList(List=remap.Mapped, Index=subtraction_2)  # -> ListA, ListB
split_3 = SplitList(List=remap_2.Mapped, Index=subtraction_3)  # -> ListA, ListB; disabled

X_4 = UnitX(Factor=1)
item_2 = ListItem(List=divide_3.Points, Index=0, Wrap=True)
move_2 = Move(Geometry=item_2, Motion=X_4)  # -> Geometry, Transform
X_5 = UnitX(Factor=-1)
Y_3 = UnitY(Factor=1)
X_6 = UnitX(Factor=1)
Y_4 = UnitY(Factor=-1)
project_5 = ProjectPoint(Point=move_2.Geometry, Direction=Y_4, Geometry=crv_2)  # -> Point, Index
project_6 = ProjectPoint(Point=move_2.Geometry, Direction=Y_3, Geometry=crv_2)  # -> Point, Index
project_7 = ProjectPoint(Point=move_2.Geometry, Direction=X_6, Geometry=crv_2)  # -> Point, Index
project_8 = ProjectPoint(Point=move_2.Geometry, Direction=X_5, Geometry=crv_2)  # -> Point, Index

X_7 = UnitX(Factor=1)  # disabled
item_3 = ListItem(List=divide_5.Points, Index=0, Wrap=True)  # disabled
move_3 = Move(Geometry=item_3, Motion=X_7)  # -> Geometry, Transform; disabled
X_8 = UnitX(Factor=-1)  # disabled
Y_5 = UnitY(Factor=1)  # disabled
X_9 = UnitX(Factor=1)  # disabled
Y_6 = UnitY(Factor=-1)  # disabled
project_9 = ProjectPoint(Point=move_3.Geometry, Direction=Y_6, Geometry=crv_3)  # -> Point, Index; disabled
project_10 = ProjectPoint(Point=move_3.Geometry, Direction=Y_5, Geometry=crv_3)  # -> Point, Index; disabled
project_11 = ProjectPoint(Point=move_3.Geometry, Direction=X_9, Geometry=crv_3)  # -> Point, Index; disabled
project_12 = ProjectPoint(Point=move_3.Geometry, Direction=X_8, Geometry=crv_3)  # -> Point, Index; disabled

panel = Panel("""0
-1""")  # disabled
panel_2 = Panel("""0
-1""")

cull_i = CullIndex(List=divide_2.Points, Indices=panel, Wrap=True)  # disabled
X_10 = UnitX(Factor=split.ListB)  # disabled
neg = Negative(Value=1)  # disabled
move_4 = Move(Geometry=cull_i, Motion=X_10)  # -> Geometry, Transform; disabled
Y_7 = UnitY(Factor=neg)  # disabled
project_13 = ProjectPoint(Point=move_4.Geometry, Direction=Y_7, Geometry=crv)  # -> Point, Index; disabled

X_11 = UnitX(Factor=split.ListA)  # disabled
cull_i_2 = CullIndex(List=divide.Points, Indices=panel, Wrap=True)  # disabled
move_5 = Move(Geometry=cull_i_2, Motion=X_11)  # -> Geometry, Transform; disabled
Y_8 = UnitY(Factor=1)  # disabled
project_14 = ProjectPoint(Point=move_5.Geometry, Direction=Y_8, Geometry=crv)  # -> Point, Index; disabled

panel_3 = Panel("""0
-1""")  # disabled

cull_i_3 = CullIndex(List=divide_4.Points, Indices=panel_2, Wrap=True)
X_12 = UnitX(Factor=split_2.ListB)
neg_2 = Negative(Value=1)
move_6 = Move(Geometry=cull_i_3, Motion=X_12)  # -> Geometry, Transform
Y_9 = UnitY(Factor=neg_2)
project_15 = ProjectPoint(Point=move_6.Geometry, Direction=Y_9, Geometry=crv_2)  # -> Point, Index

X_13 = UnitX(Factor=split_2.ListA)
cull_i_4 = CullIndex(List=divide_3.Points, Indices=panel_2, Wrap=True)
move_7 = Move(Geometry=cull_i_4, Motion=X_13)  # -> Geometry, Transform
Y_10 = UnitY(Factor=1)
project_16 = ProjectPoint(Point=move_7.Geometry, Direction=Y_10, Geometry=crv_2)  # -> Point, Index

cull_i_5 = CullIndex(List=divide_6.Points, Indices=panel_3, Wrap=True)  # disabled
X_14 = UnitX(Factor=split_3.ListB)  # disabled
neg_3 = Negative(Value=1)  # disabled
move_8 = Move(Geometry=cull_i_5, Motion=X_14)  # -> Geometry, Transform; disabled
Y_11 = UnitY(Factor=neg_3)  # disabled
project_17 = ProjectPoint(Point=move_8.Geometry, Direction=Y_11, Geometry=crv_3)  # -> Point, Index; disabled

X_15 = UnitX(Factor=split_3.ListA)  # disabled
cull_i_6 = CullIndex(List=divide_5.Points, Indices=panel_3, Wrap=True)  # disabled
move_9 = Move(Geometry=cull_i_6, Motion=X_15)  # -> Geometry, Transform; disabled
Y_12 = UnitY(Factor=1)  # disabled
project_18 = ProjectPoint(Point=move_9.Geometry, Direction=Y_12, Geometry=crv_3)  # -> Point, Index; disabled

ln = Line(StartPoint=move.Geometry, EndPoint=project_3.Point)  # disabled
# COMBINATION
curveshatter = CurveShatter(Curve=ln, Points=move_5.Geometry, Tolerance=0.01)  # disabled
curveshatter_2 = CurveShatter(Curve=ln, Points=move_4.Geometry, Tolerance=0.01)  # disabled
rev = ReverseList(List=curveshatter)  # disabled
merge = Merge(Data1=rev, Data2=curveshatter_2)  # disabled

rev_2 = ReverseList(List=project_14.Point)  # disabled
merge_2 = Merge(
    Data1=project_3.Point,
    Data2=rev_2,
    Data3=project_2.Point,
    Data4=project_4.Point,
    Data5=project.Point,
    Data6=project_13.Point)  # -> flatten(Result); disabled
curveshatter_3 = CurveShatter(Curve=crv, Points=flatten(merge_2), Tolerance=0.01)  # disabled

ln_2 = Line(StartPoint=move_2.Geometry, EndPoint=project_7.Point)
# COMBINATION
curveshatter_4 = CurveShatter(Curve=ln_2, Points=move_7.Geometry, Tolerance=0.01)
curveshatter_5 = CurveShatter(Curve=ln_2, Points=move_6.Geometry, Tolerance=0.01)
rev_3 = ReverseList(List=curveshatter_4)
merge_3 = Merge(Data1=rev_3, Data2=curveshatter_5)

ln_3 = Line(StartPoint=move_3.Geometry, EndPoint=project_11.Point)  # disabled
# COMBINATION
curveshatter_6 = CurveShatter(Curve=ln_3, Points=move_9.Geometry, Tolerance=0.01)  # disabled
curveshatter_7 = CurveShatter(Curve=ln_3, Points=move_8.Geometry, Tolerance=0.01)  # disabled
rev_4 = ReverseList(List=curveshatter_6)  # disabled
merge_4 = Merge(Data1=rev_4, Data2=curveshatter_7)  # disabled

area = Area(Geometry=crv)  # -> Area, Centroid; disabled

rev_5 = ReverseList(List=project_16.Point)
merge_5 = Merge(
    Data1=project_7.Point,
    Data2=rev_5,
    Data3=project_6.Point,
    Data4=project_8.Point,
    Data5=project_5.Point,
    Data6=project_15.Point)  # -> flatten(Result)
curveshatter_8 = CurveShatter(Curve=crv_2, Points=flatten(merge_5), Tolerance=0.01)

rev_6 = ReverseList(List=project_18.Point)  # disabled
merge_6 = Merge(
    Data1=project_11.Point,
    Data2=rev_6,
    Data3=project_10.Point,
    Data4=project_12.Point,
    Data5=project_9.Point,
    Data6=project_17.Point)  # -> flatten(Result); disabled
curveshatter_9 = CurveShatter(Curve=crv_3, Points=flatten(merge_6), Tolerance=0.01)  # disabled

rev_7 = ReverseList(List=curveshatter_3)  # disabled
rev_8 = ReverseList(List=curveshatter_8)
rev_9 = ReverseList(List=curveshatter_9)  # disabled

# ---- group: Indoor Corridor
corr_and_curve = Curve(<curve referenced from the Rhino model>)  # disabled
corr = Curve(<curve referenced from the Rhino model>)  # disabled

# ----
number_slider_14 = Slider(0, range=0..20)  # disabled
rdiff = RegionDifference(CurvesA=corr_and_curve, CurvesB=corr)  # disabled

# ---- group: Indoor Corridor
corr_and_curve_2 = Curve(<curve referenced from the Rhino model>)
corr_2 = Curve(<curve referenced from the Rhino model>)

corr_and_curve_3 = Curve(<curve referenced from the Rhino model>)  # disabled
corr_3 = Curve(<curve referenced from the Rhino model>)  # disabled

# ----
area_2 = Area(Geometry=crv_2)  # -> Area, Centroid
area_3 = Area(Geometry=crv_3)  # -> Area, Centroid; disabled
number_slider_15 = Slider(0, range=0..20)  # disabled
number_slider_16 = Slider(11, range=0..20)  # disabled
item_4 = ListItem(List=rdiff, Index=number_slider_14, Wrap=True)  # disabled
rdiff_2 = RegionDifference(CurvesA=corr_and_curve_2, CurvesB=corr_2)
rdiff_3 = RegionDifference(CurvesA=corr_and_curve_3, CurvesB=corr_3)  # disabled
crv_4 = Curve(<curve referenced from the Rhino model>)
number_slider_17 = Slider(11, range=0..20)  # disabled
item_5 = ListItem(List=rdiff_3, Index=number_slider_15, Wrap=True)  # disabled
item_6 = ListItem(List=rdiff_2, Index=Slider(0, range=0..20), Wrap=True)
panel_4 = Panel("1200")  # disabled

panel_5 = Panel("Top")  # disabled
img_setting = ImageSetting(ImageSaveAsName="defaultName", RhinoViewNames=panel_5, Width=panel_4, Height="600")  # disabled

# ---- group: No. single rooms
number_slider_18 = Slider(4, range=0..6)  # disabled

# ---- group: Single Room Area
number_slider_19 = Slider(16, range=15..30)  # disabled

# ---- group: Double Room Area
number_slider_20 = Slider(21, range=20..30)  # disabled

# ---- group: No. single rooms
number_slider_21 = Slider(4, range=0..6)

# ---- group: Single Room Area
number_slider_22 = Slider(16, range=15..30)

# ---- group: Double Room Area
number_slider_23 = Slider(21, range=20..30)

# ---- group: No. single rooms
number_slider_24 = Slider(4, range=0..6)  # disabled

# ---- group: Single Room Area
number_slider_25 = Slider(16, range=15..30)  # disabled

# ---- group: Double Room Area
number_slider_26 = Slider(21, range=20..30)  # disabled

# ----
panel_6 = Panel("D:\OneDrive - Politecnico di Milano\Arcoquattro\13_18_IBIS centro_Milano_NUOVO art.40_maggio_2020\Me\Grasshopper\Colibri")  # disabled
number_slider_27 = Slider(1, range=0..15)  # disabled
number_slider_28 = Slider(2, range=0..15)  # disabled
number_slider_29 = Slider(2, range=0..15)  # disabled
number_slider_30 = Slider(3, range=0..15)  # disabled
number_slider_31 = Slider(2, range=0..15)
number_slider_32 = Slider(1, range=0..15)
number_slider_33 = Slider(2, range=0..15)
number_slider_34 = Slider(6, range=0..15)
toggle = BooleanToggle(False)  # disabled
number_slider_35 = Slider(0, range=0..15)  # disabled
number_slider_36 = Slider(2, range=0..15)  # disabled
number_slider_37 = Slider(0, range=0..15)  # disabled
number_slider_38 = Slider(10, range=0..15)  # disabled
merge_7 = Merge(Data1=number_slider_29, Data2=number_slider_28, Data3=number_slider_30, Data4=number_slider_27)  # disabled
merge_8 = Merge(Data1=number_slider_33, Data2=number_slider_32, Data3=number_slider_34, Data4=number_slider_31)
merge_9 = Merge(Data1=number_slider_37, Data2=number_slider_36, Data3=number_slider_38, Data4=number_slider_35)  # disabled
number_of_color = Slider(7, range=5..20)  # disabled
number_slider_39 = Slider(19, range=0..50)  # disabled
galapagos = Galapagos(
    fitness=addition,
    gene=[number_slider_2, number_slider, genes, number_slider_29, number_slider_28, number_slider_30, number_slider_27])
number_of_color_2 = Slider(7, range=5..20)
number_of_color_3 = Slider(7, range=5..20)  # disabled
galapagos_2 = Galapagos(
    fitness=ma_4,
    gene=[number_slider_6, number_slider_7, number_slider_33, number_slider_32, number_slider_34, number_slider_31, genes_2])
number_slider_40 = Slider(19, range=0..50)  # disabled
wheel = ColourWheel(
    number_of_color,
    ColourGrips_Style=10,
    ColourGrips_Grip=[5.18399621, 2.094395102, 4.188790205, 3.141592654],
    ColourGrips_Lum=[0.505372241, 0.7423425875],
    ColourGrips_Range=[3.138618891, 3.138618891, 3.138618891, 3.138618891],
    ColourGrips_Sat=[0.9495531742, 0.771921156])  # disabled
wheel_2 = ColourWheel(
    number_of_color_2,
    ColourGrips_Style=10,
    ColourGrips_Grip=[5.18399621, 2.094395102, 4.188790205, 3.141592654],
    ColourGrips_Lum=[0.505372241, 0.7423425875],
    ColourGrips_Range=[3.138618891, 3.138618891, 3.138618891, 3.138618891],
    ColourGrips_Sat=[0.9495531742, 0.771921156])
wheel_3 = ColourWheel(
    number_of_color_3,
    ColourGrips_Style=10,
    ColourGrips_Grip=[5.18399621, 2.094395102, 4.188790205, 3.141592654],
    ColourGrips_Lum=[0.505372241, 0.7423425875],
    ColourGrips_Range=[3.138618891, 3.138618891, 3.138618891, 3.138618891],
    ColourGrips_Sat=[0.9495531742, 0.771921156])  # disabled
number_slider_41 = Slider(0.7, range=0..1)  # disabled
number_slider_42 = Slider(0, range=0..1)  # disabled
number_slider_43 = Slider(0, range=0..1)  # disabled
number_slider_44 = Slider(0.7, range=0..1)  # disabled
fughe_mm = Slider(5, range=0..5)  # disabled
spessore_mm = Slider(9, range=1..20)  # disabled
smusso_mm = Slider(2, range=0.5..10)  # disabled
n_in_x = Slider(6, range=1..100)  # disabled
n_in_y = Slider(6, range=1..100)  # disabled
panel_7 = Panel("200")  # disabled
panel_8 = Panel("2")  # disabled
hexgrid = Hexagonal(Plane=PlaneXY(0, 0, 0), Size=panel_7, ExtentX=n_in_x, ExtentY=n_in_y)  # -> Cells, Points; disabled
division = Division(A=fughe_mm, B=panel_8)  # disabled
panel_9 = Panel("6")  # disabled
neg_4 = Negative(Value=division)  # disabled
polygon = Polygon(Plane=hexgrid.Points, Radius=panel_7, Segments=panel_9, FilletRadius=0)  # -> Polygon, Length; disabled
offset = OffsetCurve(Curve=polygon.Polygon, Distance=neg_4, Plane=PlaneXY(0, 0, 0), Corners=1)  # disabled
boundary = BoundarySurfaces(Edges=offset)  # disabled
Z = UnitZ(Factor=spessore_mm)  # disabled
extr = Extrude(Base=boundary, Direction=Z)  # disabled
panel_10 = Panel("""3
6
8
11
14
16""")  # disabled
filedge = FilletEdge(Shape=extr, Blend=0, Metric=0, Edges=panel_10, Radii=smusso_mm)  # -> flatten(Result); disabled

ln_4 = Line(StartPoint=[move.Geometry, move_5.Geometry], EndPoint=[project_2.Point, project_14.Point])  # -> flatten(Line); disabled
ln_5 = Line(StartPoint=[move.Geometry, move_4.Geometry], EndPoint=[project.Point, project_13.Point])  # -> flatten(Line); disabled
ln_6 = Line(StartPoint=move.Geometry, EndPoint=project_4.Point)  # -> flatten(Line); disabled

rev_10 = ReverseList(List=ln_4)  # disabled

merge_10 = Merge(Data1=rev_10, Data2=ln_6, Data3=ln_5)  # disabled

python = GhPythonScript(x=merge_10, y=merge)  # -> out, final, b; inputs x: list of Curve, y: list of Curve; disabled
# ---------- python: Python ----------
__author__ = "A. El Maraghy"
__version__ = "2020.06.10"
import ghpythonlib.treehelpers as th
import rhinoscriptsyntax as rs
j = 0
print(len(x))
print(len(y))

a = []
b = []
b.append([x[1]])

for i in range(len(x)):
    #print("i main =",i)
    #print("j main=",j)
    
    if i == 0:
        a.append([x[i],y[i]])
        j = j+1
        print(a)
    if i == (len(x) - 1):
        #print("i end =",i)
        #print("j end =",j)
        a.append([x[i],y[j]])
        break
    result = rs.CurveCurveIntersection(x[i],x[i+1])
    #pointA1 = rs.CurveStartPoint(x[i])
    #pointA2 = rs.CurveEndPoint(x[i])
    #pointB1 = rs.CurveStartPoint(x[i+1])
    #pointB2 = rs.CurveEndPoint(x[i+1])
    #result2 = rs.VectorDotProduct(rs.VectorCreate(pointA2, pointA1),rs.VectorCreate(pointB2, pointB1))
    #print("result", result)
    if result is None:
        a.append([x[i],y[j],x[i+1]])
        j = j+1
        
        
    else:
        a.append([x[i],x[i+1]])
a = th.list_to_tree(a, source=[0,0])
final = a
# ---------- end python ----------
join = JoinCurves(Curves=simplify(python.final), Preserve=False)  # disabled
merge_11 = Merge(Data1=simplify(join), Data2=simplify(graft(rev_7)))  # disabled
join_2 = JoinCurves(Curves=simplify(merge_11), Preserve=False)  # -> flatten(Curves); disabled
rdiff_4 = RegionDifference(CurvesA=join_2, CurvesB=corr)  # disabled
python_2 = GhPythonScript(rooms=rdiff_4, corr=item_4)  # -> out, final, b; inputs rooms: list of Curve, corr: Curve; disabled
# ---------- python_2: Python ----------
__author__ = "A. El Maraghy"
__version__ = "2020.06.10"
import ghpythonlib.treehelpers as th
import rhinoscriptsyntax as rs


a = []
#print(corr)

for i in range(len(rooms)):
    result = rs.CurveBooleanIntersection(rooms[i], corr, tolerance=None)
    if not result:
        a.append(rooms[i])
        
a = th.list_to_tree(a, source=[0,0])
final = a
# ---------- end python_2 ----------
area_4 = Area(Geometry=python_2.final)  # -> Area, Centroid; disabled
item_7 = ListItem(List=python_2.final, Index=number_slider_16, Wrap=True)  # disabled
lng = ListLength(List=area_4.Area)  # disabled
dup = DuplicateData(Data=number_slider_20, Number=lng, Order=invert(True))  # disabled
subtraction_4 = Subtraction(A=lng, B=1)  # disabled
boundary_2 = BoundarySurfaces(Edges=python_2.final)  # disabled
smaller = SmallerThan(FirstNumber=merge_7, SecondNumber=subtraction_4)  # -> SmallerThan, OrEqualTo; disabled
ma = MassAddition(Input=area_4.Area)  # -> Result, PartialResults; disabled
cull = CullPattern(List=merge_7, CullPattern=smaller.OrEqualTo)  # disabled
expression = Expression(x=area.Area, y=ma.Result, Expression="(x - y)²")  # disabled
replace = ReplaceItems(List=dup, Item=number_slider_19, Indices=cull, Wrap=False)  # disabled
expression_2 = Expression(x=replace, y=area_4.Area, Expression="(x - y)²")  # disabled
ma_2 = MassAddition(Input=expression_2)  # -> Result, PartialResults; disabled
panel_11 = Panel(replace)  # disabled
addition = Addition(A=expression, B=ma_2.Result)  # disabled
lng_2 = ListLength(List=lng)  # disabled
repeat = RepeatData(Data=wheel, Length=lng)  # disabled
jitter = Jitter(List=repeat, Jitter=1, Seed=number_slider_39)  # -> Values, Indices; disabled
preview_metal = PreviewMetal(Colour=jitter.Values, Reflection=number_slider_41, Smoothness=number_slider_42)  # -> Mat; inputs Colour: Color, Reflection: Double, Smoothness: Double; disabled
# ---------- preview_metal: C# usings ----------
using System.IO;
using System.Linq;
using System.Data;
using System.Drawing;
using System.Reflection;
using System.Windows.Forms;
using System.Xml;
using System.Xml.Linq;
using System.Runtime.InteropServices;

using Rhino.DocObjects;
using Rhino.Collections;
using GH_IO;
using GH_IO.Serialization;
# ---------- preview_metal: C# ----------
    Reflection = Math.Min(Math.Max(Reflection, 0), 1);
    Smoothness = Math.Min(Math.Max(Smoothness, 0), 1);

    Material material = new Material();
    material.ReflectionColor = Colour;
    material.DiffuseColor = Colour;
    material.AmbientColor = Color.Black;
    material.EmissionColor = Color.Black;
    material.Reflectivity = Reflection;
    material.ReflectionGlossiness = Smoothness;

    var renderMaterial = Rhino.Render.RenderMaterial.CreateBasicMaterial(material);
    Mat = new GH_Material(renderMaterial);
# ---------- end preview_metal ----------
preview = CustomPreview(Geometry=boundary_2, Material=preview_metal)  # disabled

ln_7 = Line(StartPoint=[move_2.Geometry, move_7.Geometry], EndPoint=[project_6.Point, project_16.Point])  # -> flatten(Line)
ln_8 = Line(StartPoint=[move_2.Geometry, move_6.Geometry], EndPoint=[project_5.Point, project_15.Point])  # -> flatten(Line)
ln_9 = Line(StartPoint=move_2.Geometry, EndPoint=project_8.Point)  # -> flatten(Line)

rev_11 = ReverseList(List=ln_7)

merge_12 = Merge(Data1=rev_11, Data2=ln_9, Data3=ln_8)

python_3 = GhPythonScript(x=merge_12, y=merge_3)  # -> out, final, b; inputs x: list of Curve, y: list of Curve; same code as python
join_3 = JoinCurves(Curves=simplify(python_3.final), Preserve=False)
merge_13 = Merge(Data1=simplify(join_3), Data2=simplify(graft(rev_8)))
join_4 = JoinCurves(Curves=simplify(merge_13), Preserve=False)  # -> flatten(Curves)
rdiff_5 = RegionDifference(CurvesA=join_4, CurvesB=corr_2)
python_4 = GhPythonScript(rooms=rdiff_5, corr=crv_4)  # -> out, final, b; inputs rooms: list of Curve, corr: Curve; same code as python_2
rdiff_6 = RegionDifference(CurvesA=python_4.final, CurvesB=item_6)
item_8 = ListItem(List=python_4.final, Index=Slider(11, range=0..20), Wrap=True)
area_5 = Area(Geometry=rdiff_6)  # -> Area, Centroid
lng_3 = ListLength(List=area_5.Area)
parameters = ColibriParameters(
    Upper_Corridor=flatten(number_slider_6),
    Lower_Corridor=flatten(number_slider_7),
    Single_rooms=flatten(number_slider_21),
    Double_rooms=flatten(lng_3),
    Genes=flatten(genes_2),
    Pos_SR1=flatten(number_slider_33),
    Pos_SR2=flatten(number_slider_32),
    Pos_SR3=flatten(number_slider_34),
    Pos_SR4=flatten(number_slider_31))
panel_12 = Panel(area_5.Area)
int = Integer(area_5.Area)
dup_2 = DuplicateData(Data=number_slider_23, Number=lng_3, Order=invert(True))
subtraction_5 = Subtraction(A=lng_3, B=1)
boundary_3 = BoundarySurfaces(Edges=rdiff_6)
smaller_2 = SmallerThan(FirstNumber=merge_8, SecondNumber=subtraction_5)  # -> SmallerThan, OrEqualTo
ma_3 = MassAddition(Input=area_5.Area)  # -> Result, PartialResults
tag = TextTag(Location=area_5.Centroid, Text=int, Colour=ColourSwatch(SwatchColor=RGB(5, 3, 3)))
cull_2 = CullPattern(List=merge_8, CullPattern=smaller_2.OrEqualTo)
replace_2 = ReplaceItems(List=dup_2, Item=number_slider_22, Indices=cull_2, Wrap=False)
expression_3 = Expression(x=replace_2, y=area_5.Area, Expression="(x - y)²")
expression_4 = Expression(x=area_2.Area, y=ma_3.Result, Expression="Abs(x - y)")
ma_4 = MassAddition(Input=expression_3)  # -> Result, PartialResults
concat = Concatenate(FragmentA="Area", FragmentB=ma_4.Result)

img_setting_2 = ImageSetting(ImageSaveAsName=concat, RhinoViewNames="Top", Width="1200", Height="600")

addition_2 = Addition(A=expression_4, B=ma_4.Result)
# Image Settings
parameters_2 = ColibriParameters(ObjFun=flatten([number_slider_6, addition_2]))
aggregator = ColibriAggregator(
    Folder="D:\Colibri",
    IterationGenomeID=parameters,
    IterationPhenomeResults=parameters_2,
    ImgSetting=img_setting_2,
    Write=Toggle(True),
    recordingMode=3)
repeat_2 = RepeatData(Data=wheel_2, Length=lng_3)
jitter_2 = Jitter(List=repeat_2, Jitter=1, Seed=Slider(19, range=0..50))  # -> Values, Indices
preview_metal_2 = PreviewMetal(Colour=jitter_2.Values, Reflection=Slider(0.7, range=0..1), Smoothness=Slider(0, range=0..1))  # -> Mat; inputs Colour: Color, Reflection: Double, Smoothness: Double; same code as preview_metal
preview_2 = CustomPreview(Geometry=boundary_3, Material=preview_metal_2)

ln_10 = Line(StartPoint=[move_3.Geometry, move_9.Geometry], EndPoint=[project_10.Point, project_18.Point])  # -> flatten(Line); disabled
ln_11 = Line(StartPoint=[move_3.Geometry, move_8.Geometry], EndPoint=[project_9.Point, project_17.Point])  # -> flatten(Line); disabled
ln_12 = Line(StartPoint=move_3.Geometry, EndPoint=project_12.Point)  # -> flatten(Line); disabled

rev_12 = ReverseList(List=ln_10)  # disabled

merge_14 = Merge(Data1=rev_12, Data2=ln_12, Data3=ln_11)  # disabled

python_5 = GhPythonScript(x=merge_14, y=merge_4)  # -> out, final, b; inputs x: list of Curve, y: list of Curve; disabled; same code as python
join_5 = JoinCurves(Curves=simplify(python_5.final), Preserve=False)  # disabled
merge_15 = Merge(Data1=simplify(join_5), Data2=simplify(graft(rev_9)))  # disabled
join_6 = JoinCurves(Curves=simplify(merge_15), Preserve=False)  # -> flatten(Curves); disabled
rdiff_7 = RegionDifference(CurvesA=join_6, CurvesB=corr_3)  # disabled
python_6 = GhPythonScript(rooms=rdiff_7, corr=item_5)  # -> out, final, b; inputs rooms: list of Curve, corr: Curve; disabled; same code as python_2
area_6 = Area(Geometry=python_6.final)  # -> Area, Centroid; disabled
item_9 = ListItem(List=python_6.final, Index=number_slider_17, Wrap=True)  # disabled
lng_4 = ListLength(List=area_6.Area)  # disabled
parameters_3 = ColibriParameters(
    Upper_Corridor=flatten(number_slider_9),
    Lower_Corridor=flatten(number_slider_10),
    Single_rooms=flatten(number_slider_24),
    Double_rooms=flatten(lng_4))  # disabled
dup_3 = DuplicateData(Data=number_slider_26, Number=lng_4, Order=invert(True))  # disabled
subtraction_6 = Subtraction(A=lng_4, B=1)  # disabled
boundary_4 = BoundarySurfaces(Edges=python_6.final)  # disabled
smaller_3 = SmallerThan(FirstNumber=merge_9, SecondNumber=subtraction_6)  # -> SmallerThan, OrEqualTo; disabled
ma_5 = MassAddition(Input=area_6.Area)  # -> Result, PartialResults; disabled
cull_3 = CullPattern(List=merge_9, CullPattern=smaller_3.OrEqualTo)  # disabled
expression_5 = Expression(x=area_3.Area, y=ma_5.Result, Expression="(x - y)²")  # disabled
replace_3 = ReplaceItems(List=dup_3, Item=number_slider_25, Indices=cull_3, Wrap=False)  # disabled
expression_6 = Expression(x=replace_3, y=area_6.Area, Expression="(x - y)²")  # disabled
ma_6 = MassAddition(Input=expression_6)  # -> Result, PartialResults; disabled
panel_13 = Panel(replace_3)  # disabled
addition_3 = Addition(A=expression_5, B=ma_6.Result)  # disabled
# Image Settings
parameters_4 = ColibriParameters(Obj_fun=flatten([number_slider_9, addition_3]))  # disabled
aggregator_2 = ColibriAggregator(
    Folder=panel_6,
    IterationGenomeID=parameters_3,
    IterationPhenomeResults=parameters_4,
    ImgSetting=img_setting,
    Write=toggle,
    recordingMode=3)  # disabled
lng_5 = ListLength(List=lng_4)  # disabled
repeat_3 = RepeatData(Data=wheel_3, Length=lng_4)  # disabled
jitter_3 = Jitter(List=repeat_3, Jitter=1, Seed=number_slider_40)  # -> Values, Indices; disabled
preview_metal_3 = PreviewMetal(Colour=jitter_3.Values, Reflection=number_slider_44, Smoothness=number_slider_43)  # -> Mat; inputs Colour: Color, Reflection: Double, Smoothness: Double; disabled; same code as preview_metal
preview_3 = CustomPreview(Geometry=boundary_4, Material=preview_metal_3)  # disabled
